# Grasshopper definition 2025_07-21 GrecoRomanTheatreSeating.gh (Grasshopper 1.0.8)
# plug-ins: Pufferfish

starting_point_for_hemicircle = Point("0,0,0")
panel = Panel("Datum for Stage")
number_slider = Slider(50, range=0..100)
rad = Radians(Degrees=Slider(180, range=0..360))
rad_2 = Radians(Degrees=Slider(0, range=0..360))
dom = ConstructDomain(DomainStart=rad_2, DomainEnd=rad)
cir = Circle(Plane=starting_point_for_hemicircle, Radius=number_slider)  # disabled
arc = Arc(Plane=starting_point_for_hemicircle, Radius=number_slider, Angle=dom)  # -> Arc, Length
clscrv = CloseCurve(Curve=arc.Arc, CloseType=0, Bulge=0.5, Tolerance=0)  # -> Closed, R
srf = Surface(clscrv.Closed)
end = EndPoints(STAGEARC=arc.Arc)  # -> Start, End
vec2pt = Vector2Pt(PointA=end.Start, PointB=end.End, Unitize=False)  # -> Vector, Length
number_slider_2 = Slider(6.5, range=0..15)
number_slider_3 = Slider(27.5, range=0..50)
number_slider_4 = Slider(6.5, range=0..15)
number_slider_5 = Slider(27.5, range=0..50)
number_slider_6 = Slider(20, range=0..50)
number_slider_7 = Slider(6.5, range=0..15)
offsetvalsfordatums = Merge(
    Data1=number_slider_3,
    Data2=number_slider_4,
    Data3=number_slider_5,
    Data4=number_slider_2,
    Data5=number_slider_6,
    Data6=number_slider_7)
ma = MassAddition(Input=offsetvalsfordatums)  # -> Result, PartialResults
panel_2 = Panel(ma.Result)
amp = Amplitude(Vector=vec2pt.Vector, Amplitude=panel_2)
panel_3 = Panel("""Praecinctioes 1
--Inner Edge""")
panel_4 = Panel("""Praecinctioes 1
--Outer Edge""")
panel_5 = Panel("""Praecinctioes 2
--Inner Edge""")
panel_6 = Panel("""Praecinctioes 2
--Outer Edge""")
panel_7 = Panel("""Praecinctioes 3
--Inner Edge""")
panel_8 = Panel("""Praecinctioes 3
--Outer Edge""")
abs = Absolute(Value=amp)
offset = OffsetCurve(Curve=arc.Arc, Distance=number_slider_3, Corners=1)
offset_2 = OffsetCurve(Curve=offset, Distance=number_slider_4, Corners=1)
offset_3 = OffsetCurve(Curve=offset_2, Distance=number_slider_5, Corners=1)
offset_4 = OffsetCurve(Curve=offset_3, Distance=number_slider_2, Corners=1)
offset_5 = OffsetCurve(Curve=offset_4, Distance=number_slider_6, Corners=1)
offset_6 = OffsetCurve(Curve=offset_5, Distance=number_slider_7, Corners=1)
theatre_origin = Point(starting_point_for_hemicircle)
move = Move(Geometry=end.Start, Motion=abs)  # -> Geometry, Transform

end_2 = EndPoints(Curve=arc.Arc)  # -> Start, End
end_3 = EndPoints(Curve=offset)  # -> Start, End
ln = Line(StartPoint=end_2.Start, EndPoint=end_3.Start)
ln_2 = Line(StartPoint=end_2.End, EndPoint=end_3.End)
merge = Merge(Data1=ln, Data2=ln_2, Data3=arc.Arc, Data4=offset)

end_4 = EndPoints(Curve=offset)  # -> Start, End
end_5 = EndPoints(Curve=offset_2)  # -> Start, End
ln_3 = Line(StartPoint=end_4.Start, EndPoint=end_5.Start)
ln_4 = Line(StartPoint=end_4.End, EndPoint=end_5.End)
merge_2 = Merge(Data1=ln_3, Data2=ln_4, Data3=offset, Data4=offset_2)
join = JoinCurves(Curves=flatten(merge_2), Preserve=False)
srf_2 = Surface(join)

end_6 = EndPoints(Curve=offset_2)  # -> Start, End
end_7 = EndPoints(Curve=offset_3)  # -> Start, End
ln_5 = Line(StartPoint=end_6.Start, EndPoint=end_7.Start)
ln_6 = Line(StartPoint=end_6.End, EndPoint=end_7.End)
merge_3 = Merge(Data1=ln_5, Data2=ln_6, Data3=offset_2, Data4=offset_3)

end_8 = EndPoints(Curve=offset_4)  # -> Start, End
end_9 = EndPoints(Curve=offset_5)  # -> Start, End
ln_7 = Line(StartPoint=end_8.Start, EndPoint=end_9.Start)
ln_8 = Line(StartPoint=end_8.End, EndPoint=end_9.End)
merge_4 = Merge(Data1=ln_7, Data2=ln_8, Data3=offset_4, Data4=offset_5)

end_10 = EndPoints(Curve=offset_3)  # -> Start, End
end_11 = EndPoints(Curve=offset_4)  # -> Start, End
ln_9 = Line(StartPoint=end_10.Start, EndPoint=end_11.Start)
ln_10 = Line(StartPoint=end_10.End, EndPoint=end_11.End)
merge_5 = Merge(Data1=ln_9, Data2=ln_10, Data3=offset_3, Data4=offset_4)
join_2 = JoinCurves(Curves=flatten(merge_5), Preserve=False)
srf_3 = Surface(join_2)

end_12 = EndPoints(Curve=offset_5)  # -> Start, End
end_13 = EndPoints(Curve=offset_6)  # -> Start, End
ln_11 = Line(StartPoint=end_12.Start, EndPoint=end_13.Start)
ln_12 = Line(StartPoint=end_12.End, EndPoint=end_13.End)
merge_6 = Merge(Data1=ln_11, Data2=ln_12, Data3=offset_5, Data4=offset_6)
join_3 = JoinCurves(Curves=flatten(merge_6), Preserve=False)
srf_4 = Surface(join_3)

Z = UnitZ(Factor=1)
move_2 = Move(Geometry=move.Geometry, Motion=Z)  # -> Geometry, Transform
