# Grasshopper definition 2025_07-21 StudyForTheatreCirculation.gh (Grasshopper 1.0.8)
# plug-ins: Human

panel = Panel("0,0,0")  # disabled
starting_point_for_hemicircle = Point(panel)  # disabled
starting_point_for_hemicircle_2 = Point("0,20,0")
panel_2 = Panel("Datum for Stage")  # disabled
panel_3 = Panel("Datum for Stage")
number_slider = Slider(90, range=0..100)
number_slider_2 = Slider(90, range=0..100)  # disabled
X = UnitX(Factor=number_slider_2)  # disabled
Z = UnitZ(Factor="6/12")
number_slider_3 = Slider(60, range=0..100)  # disabled
theatre_origin = Point(starting_point_for_hemicircle_2)
move = Move(Geometry=starting_point_for_hemicircle, Motion=X)  # -> Geometry, Transform; disabled
move_2 = Move(Geometry=starting_point_for_hemicircle_2, Motion=Z)  # -> Geometry, Transform
panel_4 = Panel("6/12")  # disabled
X_2 = UnitX(Factor="11/12")
theatre_origin_2 = Point(starting_point_for_hemicircle)  # disabled
division = Division(A=number_slider_3, B=panel_4)  # disabled
move_3 = Move(Geometry=move_2.Geometry, Motion=X_2)  # -> Geometry, Transform
vec2pt = Vector2Pt(PointA=theatre_origin, PointB=move_3.Geometry, Unitize=False)  # -> Vector, Length
Z_2 = UnitZ(Factor=number_slider_3)  # disabled
number_slider_4 = Slider(12, range=0..100)
move_4 = Move(Geometry=move.Geometry, Motion=Z_2)  # -> Geometry, Transform; disabled
series = Series(Start=0, Step=panel_4, Count=division)  # disabled
xy = XYPlane(Origin=theatre_origin_2)  # disabled
ln = Line(StartPoint=theatre_origin, EndPoint=move_2.Geometry)
ln_2 = Line(StartPoint=move_2.Geometry, EndPoint=move_3.Geometry)
ln_3 = Line(StartPoint=theatre_origin, EndPoint=move_3.Geometry)
len = Length(Curve=ln_3)
multiplication = Multiplication(A=len, B="12")
panel_5 = Panel(multiplication)
Z_3 = UnitZ(Factor=series)  # disabled
docunits = ConvertToDocumentUnits(ValueString=len)
series_2 = Series(Start=0, Step=len, Count=number_slider_4)  # -> graft(Series)
series_3 = Series(Start=0, Step=expr("x*2", len), Count=expr("x/2", number_slider_4))  # -> graft(Series)
number_slider_5 = Slider(4, range=0..6)
number_slider_6 = Slider(1, range=0..6)
join = JoinCurves(Curves=[ln, ln_2, ln_3], Preserve=False)  # -> flatten(Curves)
number_slider_7 = Slider(0.7, range=0..2)  # disabled
panel_6 = Panel(docunits)
multiplication_2 = Multiplication(A="6/12", B="2")
multiplication_3 = Multiplication(A=len, B="2")
move_5 = Move(Geometry=xy, Motion=Z_3)  # -> Geometry, Transform; disabled
ln_4 = Line(StartPoint=theatre_origin_2, EndPoint=move_4.Geometry)  # disabled
panel_7 = Panel("11/12")  # disabled
neg = Negative(Value=panel_7)  # disabled
# seating height at 16"-20"
Z_4 = UnitZ(Factor=multiplication_2)
pcx = CurvePlane(Curve=ln_4, Plane=move_5.Geometry)  # -> flatten(Points), ParamsC, ParamsP; disabled
amp = Amplitude(Vector=vec2pt.Vector, Amplitude=series_2)  # -> flatten(Vector)
amp_2 = Amplitude(Vector=vec2pt.Vector, Amplitude=multiplication_3)  # -> flatten(Vector)
amp_3 = Amplitude(Vector=vec2pt.Vector, Amplitude=series_3)  # -> flatten(Vector)
series_4 = Series(Start=Slider(0, range=0..6), Step=1, Count=number_slider_6)
series_5 = Series(Start=Slider(1, range=0..6), Step=1, Count=number_slider_6)
X_3 = UnitX(Factor=neg)  # disabled
move_6 = Move(Geometry=theatre_origin, Motion=Z_4)  # -> flatten(Geometry), Transform
move_7 = Move(Geometry=theatre_origin, Motion=amp_2)  # -> flatten(Geometry), Transform
panel_8 = Panel(series_4)
panel_9 = Panel(series_5)
move_8 = Move(Geometry=pcx.Points, Motion=X_3)  # -> Geometry, Transform; disabled
shift = ShiftList(List=pcx.Points, Shift=-1, Wrap=True)  # disabled
dom = ConstructDomain(DomainStart=panel_8, DomainEnd=panel_9)  # -> graft(Domain)
ln_5 = Line(StartPoint=theatre_origin, EndPoint=move_7.Geometry)
ln_6 = Line(StartPoint=theatre_origin, EndPoint=move_6.Geometry)
ln_7 = Line(StartPoint=move_6.Geometry, EndPoint=move_7.Geometry)
ln_8 = Line(StartPoint=pcx.Points, EndPoint=move_8.Geometry)  # disabled
panel_10 = Panel(dom)
move_9 = Move(Geometry=join, Motion=amp)  # -> graft(Geometry), Transform
join_2 = JoinCurves(Curves=[ln_5, ln_6, ln_7], Preserve=False)  # -> flatten(Curves)
move_10 = Move(Geometry=join_2, Motion=amp_3)  # -> graft(Geometry), Transform
number_slider_8 = Slider(0, range=0..360)
range = Range(Domain=flatten(dom), Steps=1)
number_slider_9 = Slider(0, range=0..360)
number_slider_10 = Slider(9, range=0..360)
panel_11 = Panel(range)
addition = Addition(A=number_slider_8, B=Slider(180, range=0..360))
pt = Point("-20,20,0")
addition_2 = Addition(A=number_slider_9, B=number_slider_10)
xy_2 = XYPlane(Origin=pt)
rad = Radians(Degrees=number_slider_8)
rad_2 = Radians(Degrees=addition)
number_slider_11 = Slider(8, range=0..16)
rad_3 = Radians(Degrees=number_slider_9)
rad_4 = Radians(Degrees=addition_2)
dom_2 = ConstructDomain(DomainStart=rad, DomainEnd=rad_2)
pl_offset = PlaneOffset(BasePlane=xy_2, Offset=1)
rad_5 = Radians(Degrees=number_slider_10)
range_2 = Range(Domain=dom_2, Steps=number_slider_11)
panel_12 = Panel("20")
ln_9 = Line(StartPoint=pl_offset, EndPoint=xy_2)
dom_3 = ConstructDomain(DomainStart=rad_3, DomainEnd=rad_4)
division_2 = Division(A="180", B=number_slider_11)
rad_6 = Radians(Degrees=Slider(18, range=0..360))
multiplication_4 = Multiplication(A=rad_5, B=number_slider_11)
rad_7 = Radians(Degrees=division_2)
rotax = RotateAxis(Geometry=move_10.Geometry, Angle=range_2, Axis=ln_9)  # -> Geometry, Transform
flip = FlipCurve(Curve=ln_9)  # -> Curve, Flag
addition_3 = Addition(A=range_2, B=rad_5)
rad_8 = Radians(Degrees="180")
subtraction = Subtraction(A=rad_7, B=rad_6)
addition_4 = Addition()
subtraction_2 = Subtraction(A=rad_8, B=multiplication_4)
division_3 = Division(A=subtraction, B="2")
cull_i = CullIndex(List=addition_3, Indices="-1", Wrap=True)
division_4 = Division(A=subtraction_2, B=number_slider_11)
rotax_2 = RotateAxis(Geometry=move_9.Geometry, Angle=cull_i, Axis=ln_9)  # -> Geometry, Transform
revsrf = Revolution(Curve=rotax.Geometry, Axis=flip.Curve, Domain=dom_3)
revsrf_2 = Revolution(Curve=rotax.Geometry, Axis=ln_9, Domain=dom_3)
revsrf_3 = Revolution(Curve=rotax_2.Geometry, Axis=ln_9, Domain=subtraction)
cull_i_2 = CullIndex(List=revsrf_2, Indices="-1", Wrap=True)
cull_i_3 = CullIndex(List=revsrf, Indices="0", Wrap="0")
merge = Merge(Data1=revsrf_3, Data2=cull_i_2, Data3=cull_i_3)  # -> flatten(Result)
cap = CapHoles(Brep=merge)
