# Grasshopper definition 2025_07-21 StudyForTheatreCirculation_r1.gh (Grasshopper 1.0.8)
# plug-ins: Pufferfish, Human

starting_point_for_hemicircle = Point("0,20,0")
panel = Panel("Datum for Stage")
number_slider = Slider(90, range=0..100)
starting_point_for_hemicircle_2 = Point("0,0,0")
theatre_origin = Point("0,0,0")
Z = UnitZ(Factor="6/12")
theatre_origin_2 = Point(starting_point_for_hemicircle)
number_slider_2 = Slider(24, range=0..100)
move = Move(Geometry=starting_point_for_hemicircle, Motion=Z)  # -> Geometry, Transform
X = UnitX(Factor="11/12")
multiplication = Multiplication(A=X, B="2")
X_2 = UnitX(Factor="11/12")
move_2 = Move(Geometry=starting_point_for_hemicircle_2, Motion=multiplication)  # -> Geometry, Transform
move_3 = Move(Geometry=starting_point_for_hemicircle_2, Motion=X)  # -> Geometry, Transform
move_4 = Move(Geometry=move.Geometry, Motion=X_2)  # -> Geometry, Transform
vec2pt = Vector2Pt(PointA=theatre_origin_2, PointB=move_4.Geometry, Unitize=False)  # -> Vector, Length
ln = Line(StartPoint=starting_point_for_hemicircle_2, EndPoint=move_2.Geometry)
ln_2 = Line(StartPoint=starting_point_for_hemicircle_2, EndPoint=move_3.Geometry)
number_slider_3 = Slider(2, range=0..100)
roundn = RoundToNearest(RemapX=True)  # -> Nearest, Index, Difference, RemappedX
division = Division(A=number_slider_2, B="2")
multiplication_2 = Multiplication(A="6/12", B="2")
ln_3 = Line(StartPoint=theatre_origin_2, EndPoint=move.Geometry)
ln_4 = Line(StartPoint=move.Geometry, EndPoint=move_4.Geometry)
ln_5 = Line(StartPoint=theatre_origin_2, EndPoint=move_4.Geometry)
len = Length(Curve=ln_5)
multiplication_3 = Multiplication(A=len, B="12")
panel_3 = Panel(multiplication_3)
series = Series(Start=0, Step=multiplication, Count=division)
series_2 = Series(Start=0, Step="11/12", Count=number_slider_2)
series_3 = Series(Start="6/12", Step="6/12", Count=number_slider_2)
series_4 = Series(Start=multiplication_2, Step=multiplication_2, Count=division)
docunits = ConvertToDocumentUnits(ValueString=len)
series_5 = Series(Start=0, Step=len, Count=number_slider_3)  # -> graft(Series)
series_6 = Series(Start=0, Step=expr("x*2", len), Count=expr("x/2", number_slider_3))  # -> graft(Series)
number_slider_4 = Slider(4, range=0..6)
number_slider_5 = Slider(1, range=0..6)
X_3 = UnitX(Factor=series)
X_4 = UnitX(Factor=series_2)
join = JoinCurves(Curves=[ln_3, ln_4, ln_5], Preserve=False)  # -> flatten(Curves)
panel_4 = Panel(docunits)
multiplication_4 = Multiplication(A="6/12", B="2")
multiplication_5 = Multiplication(A=len, B="2")
panel_5 = Panel("6/12")
Z_2 = UnitZ(Factor=series_3)
move_5 = Move(Geometry=ln_2, Motion=X_4)  # -> Geometry, Transform
Z_3 = UnitZ(Factor=series_4)
move_6 = Move(Geometry=ln, Motion=X_3)  # -> Geometry, Transform
# seating height at 16"-20"
Z_4 = UnitZ(Factor=multiplication_4)
item = ListItem(List=series, Index="-1", Wrap=True)
amp = Amplitude(Vector=vec2pt.Vector, Amplitude=series_5)  # -> flatten(Vector)
amp_2 = Amplitude(Vector=vec2pt.Vector, Amplitude=multiplication_5)  # -> flatten(Vector)
amp_3 = Amplitude(Vector=vec2pt.Vector, Amplitude=series_6)  # -> flatten(Vector)
series_7 = Series(Start=Slider(0, range=0..6), Step=1, Count=number_slider_5)
series_8 = Series(Start=Slider(1, range=0..6), Step=1, Count=number_slider_5)
move_7 = Move(Geometry=theatre_origin_2, Motion=Z_4)  # -> flatten(Geometry), Transform
move_8 = Move(Geometry=theatre_origin_2, Motion=amp_2)  # -> flatten(Geometry), Transform
move_9 = Move(Geometry=move_5.Geometry, Motion=Z_2)  # -> Geometry, Transform
move_10 = Move(Geometry=move_6.Geometry, Motion=Z_3)  # -> Geometry, Transform
xz = XZPlane(Origin=Point(0, 0, 0))
xz_2 = XZPlane(Origin=Point(0, 0, 0))
addition = Addition(A=item, B="11/12")
panel_6 = Panel(series_7)
panel_7 = Panel(series_8)
neg = Negative(Value=addition)
panel_8 = Panel(".66")
dom = ConstructDomain(DomainStart=panel_6, DomainEnd=panel_7)  # -> graft(Domain)
offset = OffsetCurve(Curve=move_10.Geometry, Distance=series_4, Plane=xz, Corners=1)  # -> flatten(Curve)
offset_2 = OffsetCurve(Curve=move_9.Geometry, Distance=series_3, Plane=xz_2, Corners=1)  # -> flatten(Curve)
X_5 = UnitX(Factor=neg)
ln_6 = Line(StartPoint=theatre_origin_2, EndPoint=move_8.Geometry)
ln_7 = Line(StartPoint=theatre_origin_2, EndPoint=move_7.Geometry)
ln_8 = Line(StartPoint=move_7.Geometry, EndPoint=move_8.Geometry)
panel_9 = Panel(dom)
rulesrf = RuledSurface(CurveA=offset, CurveB=move_10.Geometry)
rulesrf_2 = RuledSurface(CurveA=offset_2, CurveB=move_9.Geometry)
lng = ListLength(List=rulesrf_2)
multiplication_6 = Multiplication(A=lng, B=".3333")
move_11 = Move(Geometry=join, Motion=amp)  # -> graft(Geometry), Transform
move_12 = Move(Geometry=starting_point_for_hemicircle_2, Motion=X_5)  # -> Geometry, Transform
join_2 = JoinCurves(Curves=[ln_6, ln_7, ln_8], Preserve=False)  # -> flatten(Curves)
move_13 = Move(Geometry=join_2, Motion=amp_3)  # -> graft(Geometry), Transform
split = SplitList(List=rulesrf_2, Index=multiplication_6)  # -> ListA, ListB
number_slider_6 = Slider(1, range=0..10)
runion = RegionUnion(Curves=flatten(rulesrf))
number_slider_7 = Slider(0, range=0..360)
number_slider_8 = Slider(0.15, range=0..1)
panel_10 = Panel("90")
range = Range(Domain=flatten(dom), Steps=1)
runion_2 = RegionUnion(Curves=flatten(split.ListB))
runion_3 = RegionUnion(Curves=flatten(split.ListA))
number_slider_9 = Slider(0, range=0..360)
number_slider_10 = Slider(9, range=0..360)
division_2 = Division(A="45", B=number_slider_6)
panel_11 = Panel(range)
panel_12 = Panel(division_2)
division_3 = Division(A="180", B=panel_12)
multiplication_7 = Multiplication(A=number_slider_8, B="2")
addition_2 = Addition(A=number_slider_7, B=Slider(180, range=0..360))
pt = Point("-20,20,0")
addition_3 = Addition(A=number_slider_9, B=number_slider_10)
rad = Radians(Degrees=Slider(0, range=0..100))
rad_2 = Radians(Degrees=Slider(52, range=0..360))
xy = XYPlane(Origin=pt)
rad_3 = Radians(Degrees=number_slider_7)
rad_4 = Radians(Degrees=addition_2)
subtraction = Subtraction(A="1", B=multiplication_7)
number_slider_11 = Slider(8, range=0..16)
rad_5 = Radians(Degrees=number_slider_9)
rad_6 = Radians(Degrees=addition_3)
number_slider_12 = Slider(39, range=0..90)
dom_2 = ConstructDomain(DomainStart=rad, DomainEnd=rad_2)
dom_3 = ConstructDomain(DomainStart=rad_3, DomainEnd=rad_4)
multiplication_8 = Multiplication(A=subtraction, B=panel_12)
multiplication_9 = Multiplication(A=number_slider_8, B=panel_12)
subtraction_2 = Subtraction(A=panel_12, B=multiplication_9)
pl_offset = PlaneOffset(BasePlane=xy, Offset=1)
rad_7 = Radians(Degrees=number_slider_10)
series_9 = Series(Start=0, Step=subtraction_2, Count=number_slider_6)
rad_8 = Radians(Degrees=multiplication_8)
rad_9 = Radians(Degrees=multiplication_9)
range_2 = Range(Domain=dom_3, Steps=number_slider_11)
panel_13 = Panel("20")
arc = Arc(Plane=move_12.Geometry, Radius=addition, Angle=dom_2)  # -> Arc, Length
arc_2 = Arc(Plane=move_12.Geometry, Radius=addition, Angle=rad_9)  # -> Arc, Length
ln_9 = Line(StartPoint=pl_offset, EndPoint=xy)
dom_4 = ConstructDomain(DomainStart=rad_5, DomainEnd=rad_6)
division_4 = Division(A="180", B=number_slider_11)
rad_10 = Radians(Degrees=series_9)
rad_11 = Radians(Degrees=Slider(18, range=0..360))
multiplication_10 = Multiplication(A=rad_7, B=number_slider_11)
rad_12 = Radians(Degrees=division_4)
rotax = RotateAxis(Geometry=move_13.Geometry, Angle=range_2, Axis=ln_9)  # -> Geometry, Transform
flip = FlipCurve(Curve=ln_9)  # -> Curve, Flag

runion_4 = RegionUnion(Curves=flatten(rulesrf))
rotate = Rotate(Geometry=arc_2.Arc, Angle=rad_8, Plane=move_12.Geometry)  # -> Geometry, Transform
rotate_2 = Rotate(Geometry=runion_3, Angle=rad_8, Plane=move_12.Geometry)  # -> Geometry, Transform
arc_3 = Arc(Plane=move_12.Geometry, Radius=addition, Angle=rad_8)  # -> Arc, Length
swp1 = Sweep1(Rail=arc_3.Arc, Sections=runion_4, Miter=1)
swp1_2 = Sweep1(Rail=rotate.Geometry, Sections=rotate_2.Geometry, Miter=1)

addition_4 = Addition(A=range_2, B=rad_7)
rad_13 = Radians(Degrees="180")
addition_5 = Addition()
subtraction_3 = Subtraction(A=rad_12, B=rad_11)
subtraction_4 = Subtraction(A=rad_13, B=multiplication_10)
division_5 = Division(A=subtraction_3, B="2")
unsplitswp = UnsplitSweepSurface()
cull_i = CullIndex(List=addition_4, Indices="-1", Wrap=True)
division_6 = Division(A=subtraction_4, B=number_slider_11)
rotax_2 = RotateAxis(Geometry=move_11.Geometry, Angle=cull_i, Axis=ln_9)  # -> Geometry, Transform
merge = Merge(Data1=swp1_2, Data2=swp1)
rotate_3 = Rotate(Geometry=graft(merge), Angle=rad_10, Plane=move_12.Geometry)  # -> Geometry, Transform
revsrf = Revolution(Curve=rotax.Geometry, Axis=flip.Curve, Domain=dom_4)
revsrf_2 = Revolution(Curve=rotax.Geometry, Axis=ln_9, Domain=dom_4)
revsrf_3 = Revolution(Curve=rotax_2.Geometry, Axis=ln_9, Domain=subtraction_3)
cull_i_2 = CullIndex(List=revsrf_2, Indices="-1", Wrap=True)
cull_i_3 = CullIndex(List=revsrf, Indices="0", Wrap="0")
merge_2 = Merge(Data1=revsrf_3, Data2=cull_i_2, Data3=cull_i_3)  # -> flatten(Result)
cap = CapHoles(Brep=merge_2)  # disabled
