# Grasshopper definition 2025_07-21 StudyForTheatreCirculation_r2.gh (Grasshopper 1.0.8)
# plug-ins: Pufferfish, Human

starting_point_for_hemicircle = Point("0,0,0")
theatre_origin = Point("0,0,0")
starting_point_for_hemicircle_2 = Point("0,20,0")
panel = Panel("Datum for Stage")
number_slider = Slider(90, range=0..100)
rad = Radians(Degrees=Slider(100, range=0..180))
rad_2 = Radians(Degrees=Slider(29, range=0..180))
Y = UnitY(Factor=Slider(15, range=0..30))
dom = ConstructDomain(DomainStart=rad_2, DomainEnd=rad)
domain = Domain(dom)
number_slider_2 = Slider(0.7, range=0..1)
move = Move(Geometry=starting_point_for_hemicircle, Motion=Y)  # -> Geometry, Transform
arc = Arc(Plane=starting_point_for_hemicircle, Radius=Slider(15, range=0..30), Angle=domain)  # -> Arc, Length
Z = UnitZ(Factor="6/12")
step_seat_ratio_value = Panel("2")
ln = Line(StartPoint=move.Geometry, EndPoint=starting_point_for_hemicircle)
theatre_origin_2 = Point("0,0,0")
starting_point_for_hemicircle_3 = Point("0,0,0")
theatre_origin_3 = Point(starting_point_for_hemicircle_2)
move_2 = Move(Geometry=starting_point_for_hemicircle_2, Motion=Z)  # -> Geometry, Transform
X = UnitX(Factor="11/12")
starting_edge = Curve(arc.Arc)
offcrv = OffsetCurve(
    Curve=ln,
    Plane=PlaneXY(0, 0, 0),
    Distance=number_slider_2,
    BothSides=expr("x*(-1)", number_slider_2),
    Kinks=0,
    CapType=1)
move_3 = Move(Geometry=move_2.Geometry, Motion=X)  # -> Geometry, Transform
vec2pt = Vector2Pt(PointA=theatre_origin_3, PointB=move_3.Geometry, Unitize=False)  # -> Vector, Length
step_seat_ratio_value_2 = Panel("2")
slider_step_count = Slider(20, range=0..50)
riser_height = Panel("6/12")
multiplication = Multiplication(A=riser_height, B=step_seat_ratio_value)
seat_height = Panel(multiplication)
arc_2 = Arc(Plane=starting_point_for_hemicircle_3, Radius=Slider(10, range=0..30), Angle=Domain(0, 3.141592654))  # -> Arc, Length
darc = DeconstructArc(Arc=starting_edge)  # -> BasePlane, Radius, Angle
number_slider_3 = Slider(2, range=0..100)
num = Number(slider_step_count)
roundn = RoundToNearest(RemapX=True)  # -> Nearest, Index, Difference, RemappedX
starting_edge_2 = Curve(arc_2.Arc)
ln_2 = Line(StartPoint=theatre_origin_3, EndPoint=move_2.Geometry)
ln_3 = Line(StartPoint=move_2.Geometry, EndPoint=move_3.Geometry)
ln_4 = Line(StartPoint=theatre_origin_3, EndPoint=move_3.Geometry)
len = Length(Curve=ln_4)
multiplication_2 = Multiplication(A=len, B="12")
panel_3 = Panel(multiplication_2)
series = Series(Start=darc.Radius, Step=seat_height, Count=expr("x/2", num))
series_2 = Series(Start=darc.Radius, Step=riser_height, Count=num)
domain_2 = Domain(dom)
riser_height_2 = Panel("6/12")
multiplication_3 = Multiplication(A=riser_height_2, B=step_seat_ratio_value_2)
seat_height_2 = Panel(multiplication_3)
darc_2 = DeconstructArc(Arc=starting_edge_2)  # -> BasePlane, Radius, Angle
docunits = ConvertToDocumentUnits(ValueString=len)
series_3 = Series(Start=0, Step=len, Count=number_slider_3)  # -> graft(Series)
num_2 = Number(slider_step_count)
series_4 = Series(Start=0, Step=expr("x*2", len), Count=expr("x/2", number_slider_3))  # -> graft(Series)
number_slider_4 = Slider(4, range=0..6)
number_slider_5 = Slider(1, range=0..6)
join = JoinCurves(Curves=[ln_2, ln_4, ln_3], Preserve=False)  # -> flatten(Curves)
panel_4 = Panel(docunits)
multiplication_4 = Multiplication(A="6/12", B="2")
multiplication_5 = Multiplication(A=len, B="2")
series_5 = Series(Start=darc_2.Radius, Step=riser_height_2, Count=expr("x-1", num_2))
series_6 = Series(Start=darc_2.Radius, Step=seat_height_2, Count=expr("x/2", num_2))
item = ListItem(List=series_5, Index="-1", Wrap=True)
pframes = PerpFrames(Curve=starting_edge_2, Count=Slider(8, range=0..12), Align=True)  # -> Frames, Parameters
panel_5 = Panel("""0
-1""")

# ---- group: Theatre | Steps
arc_3 = Arc(Plane=darc.BasePlane, Radius=series_2, Angle=domain_2)  # -> Arc, Length

# ---- group: Theatre | Seats
arc_4 = Arc(Plane=darc.BasePlane, Radius=series, Angle=domain_2)  # -> Arc, Length

# ----
# seating height at 16"-20"
Z_2 = UnitZ(Factor=multiplication_4)
cull_i = CullIndex(List=pframes.Frames, Indices=panel_5, Wrap=True)
amp = Amplitude(Vector=vec2pt.Vector, Amplitude=series_3)  # -> flatten(Vector)
amp_2 = Amplitude(Vector=vec2pt.Vector, Amplitude=multiplication_5)  # -> flatten(Vector)
amp_3 = Amplitude(Vector=vec2pt.Vector, Amplitude=series_4)  # -> flatten(Vector)
series_7 = Series(Start=Slider(0, range=0..6), Step=1, Count=number_slider_5)
series_8 = Series(Start=Slider(1, range=0..6), Step=1, Count=number_slider_5)
move_4 = Move(Geometry=theatre_origin_3, Motion=Z_2)  # -> flatten(Geometry), Transform
move_5 = Move(Geometry=theatre_origin_3, Motion=amp_2)  # -> flatten(Geometry), Transform
dispatch = Dispatch(List=cull_i, DispatchPattern=[True, False])  # -> ListA, ListB
arc_5 = Arc(Plane=darc_2.BasePlane, Radius=item, Angle=Domain(0, 3.141592654))  # -> Arc, Length

# ---- group: Theatre | Steps
arc_6 = Arc(Plane=darc_2.BasePlane, Radius=series_5, Angle=Domain(0, 3.141592654))  # -> Arc, Length

# ---- group: Theatre | Seats
arc_7 = Arc(Plane=darc_2.BasePlane, Radius=series_6, Angle=Domain(0, 3.141592654))  # -> Arc, Length

# ----
panel_6 = Panel(series_7)
panel_7 = Panel(series_8)
pln = Plane(dispatch.ListA)
pln_2 = Plane(dispatch.ListB)
dom_2 = ConstructDomain(DomainStart=panel_6, DomainEnd=panel_7)  # -> graft(Domain)
end = EndPoints(Curve=starting_edge_2)  # -> Start, End
end_2 = EndPoints(Curve=arc_5.Arc)  # -> Start, End
ln_5 = Line(StartPoint=theatre_origin_3, EndPoint=move_5.Geometry)
ln_6 = Line(StartPoint=theatre_origin_3, EndPoint=move_4.Geometry)
ln_7 = Line(StartPoint=move_4.Geometry, EndPoint=move_5.Geometry)
panel_8 = Panel(dom_2)
move_6 = Move(Geometry=join, Motion=amp)  # -> graft(Geometry), Transform
ln_8 = Line(StartPoint=end.Start, EndPoint=end_2.Start)
ln_9 = Line(StartPoint=end.End, EndPoint=end_2.End)
join_2 = JoinCurves(Curves=[ln_5, ln_7, ln_6], Preserve=False)  # -> flatten(Curves)
move_7 = Move(Geometry=join_2, Motion=amp_3)  # -> graft(Geometry), Transform
join_3 = JoinCurves(Curves=flatten([arc_5.Arc, ln_9, ln_8, starting_edge_2]), Preserve=False)
number_slider_6 = Slider(0, range=0..360)
range = Range(Domain=flatten(dom_2), Steps=1)
number_slider_7 = Slider(0, range=0..360)
number_slider_8 = Slider(9, range=0..360)
srf = Surface(join_3)
panel_9 = Panel(range)
addition = Addition(A=number_slider_6, B=Slider(180, range=0..360))
pt = Point("-20,20,0")
sec = BrepPlane(Brep=srf, Plane=pln_2)  # -> Curves, Points
sec_2 = BrepPlane(Brep=srf, Plane=pln)  # -> Curves, Points
addition_2 = Addition(A=number_slider_7, B=number_slider_8)
xy = XYPlane(Origin=pt)
rad_3 = Radians(Degrees=number_slider_6)
rad_4 = Radians(Degrees=addition)
number_slider_9 = Slider(8, range=0..16)
rad_5 = Radians(Degrees=number_slider_7)
rad_6 = Radians(Degrees=addition_2)
dom_3 = ConstructDomain(DomainStart=rad_3, DomainEnd=rad_4)
pl_offset = PlaneOffset(BasePlane=xy, Offset=1)
rad_7 = Radians(Degrees=number_slider_8)
eval = EvaluateLength(Curve=sec_2.Curves, Normalized=True)  # -> Point, Tangent, Parameter
eval_2 = EvaluateLength(Curve=sec.Curves, Normalized=True)  # -> Point, Tangent, Parameter
range_2 = Range(Domain=dom_3, Steps=number_slider_9)
panel_10 = Panel("20")
ln_10 = Line(StartPoint=pl_offset, EndPoint=xy)
dom_4 = ConstructDomain(DomainStart=rad_5, DomainEnd=rad_6)
division = Division(A="180", B=number_slider_9)
rad_8 = Radians(Degrees=Slider(18, range=0..360))
multiplication_6 = Multiplication(A=rad_7, B=number_slider_9)
rad_9 = Radians(Degrees=division)
rotax = RotateAxis(Geometry=move_7.Geometry, Angle=range_2, Axis=ln_10)  # -> Geometry, Transform
flip = FlipCurve(Curve=ln_10)  # -> Curve, Flag
addition_3 = Addition(A=range_2, B=rad_7)
rad_10 = Radians(Degrees="180")
addition_4 = Addition()
subtraction = Subtraction(A=rad_9, B=rad_8)
subtraction_2 = Subtraction(A=rad_10, B=multiplication_6)
division_2 = Division(A=subtraction, B="2")
cull_i_2 = CullIndex(List=addition_3, Indices="-1", Wrap=True)
division_3 = Division(A=subtraction_2, B=number_slider_9)
rotax_2 = RotateAxis(Geometry=move_6.Geometry, Angle=cull_i_2, Axis=ln_10)  # -> Geometry, Transform
revsrf = Revolution(Curve=rotax.Geometry, Axis=flip.Curve, Domain=dom_4)
revsrf_2 = Revolution(Curve=rotax.Geometry, Axis=ln_10, Domain=dom_4)
revsrf_3 = Revolution(Curve=rotax_2.Geometry, Axis=ln_10, Domain=subtraction)
cull_i_3 = CullIndex(List=revsrf_2, Indices="-1", Wrap=True)
cull_i_4 = CullIndex(List=revsrf, Indices="0", Wrap="0")
merge = Merge(Data1=revsrf_3, Data2=cull_i_3, Data3=cull_i_4)  # -> flatten(Result)
cap = CapHoles(Brep=merge)  # disabled
